# Grasshopper definition Example_Beta2_ENG.gh (Grasshopper 0.9.76)
# plug-ins: Python Interpreter

# ----
# ESQUIS'SONS !
# Example File / Fichier Exemple
# 
# Creator : Théo Marchal /
# Contact :  Theo.marchal[at]grenoble.archi.fr
# 1// LAUNCHER :
# 
# Set the toogle to true to launch Esquissons.exe /
# If your Esquissons.exe is not installed in the default directory,
# set your own path in "Alt_path" /
toggle = BooleanToggle(False)
launcher = EsquisSonsLauncher(On_Off=toggle)  # -> out
# ---------- launcher: Python ----------
#Esquis'sons! Launcher is a part of Esquis'sons!
#Esquissons license : CeCILL 2.1
#Creator : Théo Marchal (theo.marchal@grenoble.archi.fr)
#
#Disclaimer : This is only a summary and not a substitute to the full License :
#The Licensee is authorized to use the Software, without any limitation as to its fields of application, with it being hereinafter specified that this comprises:
#
#	1	permanent or temporary reproduction of all or part of the Software by any or all means and in any or all form. 
#	2	loading, displaying, running, or storing the Software on any or all medium.
#	3	entitlement to observe, study or test its operation so as to determine the ideas and principles behind any or all constituent elements of said Software. This shall apply when the Licensee carries out any or all loading, displaying, running, transmission or storage operation as regards the Software, that it is entitled to carry out hereunder.
#		
#The Holder owns the economic rights over the Initial Software. Any or all use of the Initial Software is subject to compliance with the terms and conditions under which the Holder has elected to distribute its work and no one shall be entitled to modify the terms and conditions for the distribution of said Initial Software.
#
#The Licensee expressly undertakes:
#	1	not to remove, or modify, in any manner, the intellectual property notices attached to the Software;
#	2	to reproduce said notices, in an identical manner, in the copies of the Software modified or not. 
#The Licensee undertakes not to directly or indirectly infringe the intellectual property rights on the Software of the Holder and/or Contributors, and to take, where applicable, vis-à-vis its staff, any and all measures required to ensure respect of said intellectual property rights of the Holder and/or Contributors.

"""Esquis'Sons! Launcher
Use a boolean toogle to launch the sound module :)
-
AAU / Théo Marchal / BETA VERSION / MARS 2018"""

ghenv.Component.Params.Input[0].Description = "Boolean input, set True to run the Sound Algorythm"
ghenv.Component.Params.Input[0].Description = "General Status of Esquis'Sons! module"
ghenv.Component.Params.Input[1].Description = "Alternative Path to -Esquissons.exe- (Default is C:/Program Files/Esquissons/Esquissons.exe)"
ghenv.Component.Name = "Esquis'Sons! Launcher"
ghenv.Component.NickName = "Launcher" 
ghenv.Component.Message = "Esquis'sons! BETA V2"
ghenv.Component.Category = "Esquis'Sons!"
ghenv.Component.SubCategory = "0/ Esquissons!"
import os
import OSC
c = OSC.OSCClient()
d = OSC.OSCClient()
c.connect(('127.0.0.1', 58234))  
oscmsg = OSC.OSCMessage()
oscmsg.append("no message")
oscmsg.append("no int")

if Alt_path is None:
    Alt_path = "C:/Program Files/Esquissons/Esquissons.exe"
esqpath = Alt_path
if On_Off == True :
    try :
        os.startfile(esqpath)
    except :
        raise Exception(' "esquissons.exe can not be found at "'+esqpath+'Please check the installation !')
    oscmsg[0] = "EsquisSons!_is_Online_Let's_make_some_noise"
    oscmsg[1] = 1
    print "EsquisSons! is Online ! Lets make some noise !"
    print oscmsg
else :
    print "Esquis'Sons! is not Online, turn it on to start the sketch !"
    oscmsg[0] = "Esquis'Sons!_is_not_Online,_turn_it_on_in_Grasshopper_to_start_the_sketch!"
    oscmsg[1] = "0"
c.send(oscmsg)
# ---------- end launcher ----------
panel = Panel(launcher)

# ----
# 3// SOURCE :
# 
# Set your source location with a point, Default is (0,0,0) /
# Set the sound path /
# Set the source size (sphere radius) /
pt = Point(Point(1.656854326, 3.993093633, 4.677462595))
bell = BellSound("C:\Program Files\Esquissons\resources\Snd\Bell.wav")
source = SoundSource(Source_Location=pt, Source_Path=bell, Source_Size=Slider(3, range=0..10))  # -> Geo, Source; inputs Source_Location: Point3d, Source_Path: list
# ---------- source: Python ----------
#Esquis'sons! Launcher is a part of Esquis'sons!
#Esquissons license : CeCILL 2.1
#Creator : Théo Marchal (theo.marchal@grenoble.archi.fr)
#
#Disclaimer : This is only a summary and not a substitute to the full License :
#The Licensee is authorized to use the Software, without any limitation as to its fields of application, with it being hereinafter specified that this comprises:
#
#	1	permanent or temporary reproduction of all or part of the Software by any or all means and in any or all form. 
#	2	loading, displaying, running, or storing the Software on any or all medium.
#	3	entitlement to observe, study or test its operation so as to determine the ideas and principles behind any or all constituent elements of said Software. This shall apply when the Licensee carries out any or all loading, displaying, running, transmission or storage operation as regards the Software, that it is entitled to carry out hereunder.
#		
#The Holder owns the economic rights over the Initial Software. Any or all use of the Initial Software is subject to compliance with the terms and conditions under which the Holder has elected to distribute its work and no one shall be entitled to modify the terms and conditions for the distribution of said Initial Software.
#
#The Licensee expressly undertakes:
#	1	not to remove, or modify, in any manner, the intellectual property notices attached to the Software;
#	2	to reproduce said notices, in an identical manner, in the copies of the Software modified or not. 
#The Licensee undertakes not to directly or indirectly infringe the intellectual property rights on the Software of the Holder and/or Contributors, and to take, where applicable, vis-à-vis its staff, any and all measures required to ensure respect of said intellectual property rights of the Holder and/or Contributors.


"""Sound Source : Transform a point and a sound file path in an omnidirectional source object
Use point, path and slider here :)
-
AAU / Théo Marchal / BETA VERSION / MARS 2018"""

ghenv.Component.Params.Input[0].Description = "Location of the source (as a point)"
ghenv.Component.Params.Input[1].Description = "Path to the sound file (as a text)"
ghenv.Component.Params.Input[2].Description = "Source Size (Amplitude Sphere radius)"
ghenv.Component.Params.Output[0].Description = "Source representation"
ghenv.Component.Params.Output[1].Description = "Source Object"
ghenv.Component.Name = "Sound Source"
ghenv.Component.NickName = "SOURCE" 
ghenv.Component.Message = "Esquis'sons! BETA V2"
ghenv.Component.Category = "Esquis'Sons!"
ghenv.Component.SubCategory = "1/ Scene"


import rhinoscriptsyntax as rs


SL = Source_Location
SP = Source_Path
SpS = Source_Size


if SL is None:
    SL = rs.AddPoint(0,0,0)
if SP is None:
    SP = "NoSound" # if nothing is connected go to the "NoSound" file
if SpS is None:
    SpS = 1

Geo = rs.AddSphere(SL,SpS)

SD=[SP,SL,SpS]
Source = [SD]
# ---------- end source ----------

# ----
# 2// LISTENER :
# 
# Set your listener location with a point, Default is (0,0,0) /
# Set the direction (from 0 to 360°) /
# Set the Height of your listener /
number_slider = Slider(1.8, range=0..10)
listener = ListenerPoint(Direction=Slider(253.624, range=0..366), Height=number_slider)  # -> Geo, Listener; inputs Listener_Location: Point3d
# ---------- listener: Python ----------
#Esquis'sons! Launcher is a part of Esquis'sons!
#Esquissons license : CeCILL 2.1
#Creator : Théo Marchal (theo.marchal@grenoble.archi.fr)
#
#Disclaimer : This is only a summary and not a substitute to the full License :
#The Licensee is authorized to use the Software, without any limitation as to its fields of application, with it being hereinafter specified that this comprises:
#
#	1	permanent or temporary reproduction of all or part of the Software by any or all means and in any or all form. 
#	2	loading, displaying, running, or storing the Software on any or all medium.
#	3	entitlement to observe, study or test its operation so as to determine the ideas and principles behind any or all constituent elements of said Software. This shall apply when the Licensee carries out any or all loading, displaying, running, transmission or storage operation as regards the Software, that it is entitled to carry out hereunder.
#		
#The Holder owns the economic rights over the Initial Software. Any or all use of the Initial Software is subject to compliance with the terms and conditions under which the Holder has elected to distribute its work and no one shall be entitled to modify the terms and conditions for the distribution of said Initial Software.
#
#The Licensee expressly undertakes:
#	1	not to remove, or modify, in any manner, the intellectual property notices attached to the Software;
#	2	to reproduce said notices, in an identical manner, in the copies of the Software modified or not. 
#The Licensee undertakes not to directly or indirectly infringe the intellectual property rights on the Software of the Holder and/or Contributors, and to take, where applicable, vis-à-vis its staff, any and all measures required to ensure respect of said intellectual property rights of the Holder and/or Contributors.


"""Listener Component : Transform Point, angle and height in a geometry and a listener object
Use point, and sliders here :)
-
AAU / Théo Marchal / BETA VERSION / MARS 2018"""


ghenv.Component.Params.Input[0].Description = "Location of the listener foots (as a point)"
ghenv.Component.Params.Input[1].Description = "Direction of the listener (in degrees from 0 to 360)"
ghenv.Component.Params.Input[2].Description = "How tall is the listener (default = 1.80)"
ghenv.Component.Params.Output[0].Description = "Listener Geometry, size and direction"
ghenv.Component.Params.Output[1].Description = "Listener Object (plug it into Esquissons!)"
ghenv.Component.Name = "Listener Point"
ghenv.Component.NickName = "LISTENER" 
ghenv.Component.Message = "Esquis'sons! BETA V2"
ghenv.Component.Category = "Esquis'Sons!"
ghenv.Component.SubCategory = "1/ Scene"


import rhinoscriptsyntax as rs

LL = Listener_Location
LD = Direction
LH = Height

if LL is None:
    LL = rs.AddPoint(0,0,0)
if LD is None:
    LD = 0
if LH is None:
    LH = 1.8

LV = rs.VectorRotate([0,(LH),0],LD,[0,0,1]) #Vector from listener to direction
# Creation of Head with Height
matrix = rs.XformTranslation((0,0,LH))
LHp = rs.PointTransform(LL,matrix)

#Direction triangle drawing
LV2 = rs.VectorScale((rs.VectorRotate(LV,90,[0,0,1])),0.5)
LV3 = rs.VectorScale((rs.VectorRotate(LV,-90,[0,0,1])),0.5)
T1 = rs.PointTransform(LL,(rs.XformTranslation(LV)))
Tl = rs.PointTransform(LL,(rs.XformTranslation(LV2)))
Tr = rs.PointTransform(LL,(rs.XformTranslation(LV3)))
ps=[T1,Tl,Tr]
Geo = [rs.AddSphere(LHp,(LH/10)),rs.AddLine(LL,LHp),rs.AddSrfPt(ps)]
Tl = rs.PointTransform(Tl,matrix)
Tr = rs.PointTransform(Tr,matrix)
#Listener objet : [Head Point, Left Point, Right Point,Heigh reference]
LP = [LHp,Tl,Tr,LH]
Listener = [LP]
# ---------- end listener ----------

# ----
# 4// BUILT ENVIRONEMENT :
# 
# Set your geomtery with a brep /!\ Your brep must be closed  and can't be a surface with 0 thickness /!\
# Set the sonic opacity (from 1 to 4) /
geometries = Brep([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])
evt = BuiltEnvironment(Geo=geometries)  # -> Preview, flatten(Geometry); inputs Geo: GeometryBase
# ---------- evt: Python ----------
#Esquis'sons! Launcher is a part of Esquis'sons!
#Esquissons license : CeCILL 2.1
#Creator : Théo Marchal (theo.marchal@grenoble.archi.fr)
#
#Disclaimer : This is only a summary and not a substitute to the full License :
#The Licensee is authorized to use the Software, without any limitation as to its fields of application, with it being hereinafter specified that this comprises:
#
#	1	permanent or temporary reproduction of all or part of the Software by any or all means and in any or all form. 
#	2	loading, displaying, running, or storing the Software on any or all medium.
#	3	entitlement to observe, study or test its operation so as to determine the ideas and principles behind any or all constituent elements of said Software. This shall apply when the Licensee carries out any or all loading, displaying, running, transmission or storage operation as regards the Software, that it is entitled to carry out hereunder.
#		
#The Holder owns the economic rights over the Initial Software. Any or all use of the Initial Software is subject to compliance with the terms and conditions under which the Holder has elected to distribute its work and no one shall be entitled to modify the terms and conditions for the distribution of said Initial Software.
#
#The Licensee expressly undertakes:
#	1	not to remove, or modify, in any manner, the intellectual property notices attached to the Software;
#	2	to reproduce said notices, in an identical manner, in the copies of the Software modified or not. 
#The Licensee undertakes not to directly or indirectly infringe the intellectual property rights on the Software of the Holder and/or Contributors, and to take, where applicable, vis-à-vis its staff, any and all measures required to ensure respect of said intellectual property rights of the Holder and/or Contributors.


"""Environment Component : Transform Geometry and Opacity in a built environment Object
Use Brep and slider here :)
-
AAU / Théo Marchal / BETA VERSION / MARS 2018"""

ghenv.Component.Params.Input[0].Description = "Built Environment"
ghenv.Component.Params.Input[1].Description = "Geometry acoustic opacity [Btw 1 and 4]  (if none or 0 default = 3)"
ghenv.Component.Params.Output[0].Description = "Buil environment representation"
ghenv.Component.Params.Output[1].Description = "Buil environment as a geometry object"
ghenv.Component.Name = "Built Environment"
ghenv.Component.NickName = "EVT" 
ghenv.Component.Message = "Esquis'sons! BETA V2"
ghenv.Component.Category = "Esquis'Sons!"
ghenv.Component.SubCategory = "1/ Scene"

Preview = Geo
if Opacity <= 0 :
    Opacity = 3
Geo_Obj = [Geo,Opacity]
Geometry=[Geo_Obj]
print Geometry
# ---------- end evt ----------

# ----
# 5// MAIN ENGINE :
# 
# Connect all your esquissons objects to this engine (Listener,Sources & geometries) /
# Use a boolean toogle to set the reverb (on & off) /
# Set the general alpha sabine coeff (0 to 1) /
# Use a boolean toogle to reset your sources (It could be useful when you load a project or when you notice some bugs with the sources paths) /
toggle_2 = BooleanToggle(False)
esquis_sons = EsquisSonsMainEngine(
    Listener=listener.Listener,
    Sources=source.Source,
    Geometry=evt.Geometry,
    Reverb_on=toggle_2,
    alpha=Slider(0.3, range=0..1),
    Reset=Toggle(False))  # -> Vi; inputs Listener: list, Sources: list, Geometry: list, Reverb_on: Boolean
# ---------- esquis_sons: Python ----------
#Esquis'sons! Launcher is a part of Esquis'sons!
#Esquissons license : CeCILL 2.1
#Creator : Théo Marchal (theo.marchal@grenoble.archi.fr)
#
#Disclaimer : This is only a summary and not a substitute to the full License :
#The Licensee is authorized to use the Software, without any limitation as to its fields of application, with it being hereinafter specified that this comprises:
#
#	1	permanent or temporary reproduction of all or part of the Software by any or all means and in any or all form. 
#	2	loading, displaying, running, or storing the Software on any or all medium.
#	3	entitlement to observe, study or test its operation so as to determine the ideas and principles behind any or all constituent elements of said Software. This shall apply when the Licensee carries out any or all loading, displaying, running, transmission or storage operation as regards the Software, that it is entitled to carry out hereunder.
#		
#The Holder owns the economic rights over the Initial Software. Any or all use of the Initial Software is subject to compliance with the terms and conditions under which the Holder has elected to distribute its work and no one shall be entitled to modify the terms and conditions for the distribution of said Initial Software.
#
#The Licensee expressly undertakes:
#	1	not to remove, or modify, in any manner, the intellectual property notices attached to the Software;
#	2	to reproduce said notices, in an identical manner, in the copies of the Software modified or not. 
#The Licensee undertakes not to directly or indirectly infringe the intellectual property rights on the Software of the Holder and/or Contributors, and to take, where applicable, vis-à-vis its staff, any and all measures required to ensure respect of said intellectual property rights of the Holder and/or Contributors.


"""Esquis'Sons! Main Engine will calculate the auralisation.
Use Listener, Sources, Geometry objects to connect them here :)
-
AAU / Théo Marchal / BETA VERSION / MARS 2018"""

ghenv.Component.Params.Input[0].Description = "Listener Object"
ghenv.Component.Params.Input[1].Description = "Sources Objects (from Sources_n components)"
ghenv.Component.Params.Input[2].Description = "Built environment (as a geometry object)"
ghenv.Component.Params.Input[3].Description = "Set Reverb_On to True if you want to activate Reverberation (Default is off)"
ghenv.Component.Params.Output[0].Description = "Visualize output (plug it in visualize componets)"
ghenv.Component.Params.Input[3].Description = "Boolean input, set True to ativate Reverberation Algorythm"
ghenv.Component.Params.Input[4].Description = "General Sabine Coefficient for the built evt (if nothing set, default is 0.4)"
ghenv.Component.Params.Input[5].Description = "To reset sources, set to True, then turn it back to False (Boolean input)"
ghenv.Component.Name = "Esquis'Sons! Main engine"
ghenv.Component.NickName = "Esquis'Sons!" 
ghenv.Component.Message = "Esquis'sons! BETA V2 \n AAU / Théo Marchal"
ghenv.Component.Category = "Esquis'Sons!"
ghenv.Component.SubCategory = "0/ Esquissons!"

import rhinoscriptsyntax as rs
import math
import OSC

#Input errors:
try:
    Lp = ((Listener[0])[0])
    Lh = ((Listener[0])[3])
except:
    raise Exception(' A Listener must be connected !')

So_dic = dict()
if alpha == None :
    alpha = 0.4
Si =[] #Source index name ("S_n")
SDi =[] #Source reduction with distance in dB (Float)
SPa = [] #Source Path (string)
SPan = [] #Source panoramic
Spl = [] #Source Play (0/1)
Sint = []#Source Reduction with geometry (L,R)
Opa = 1 #Opacity Coefficient
Srev1 = [] #Source First Reverberation
Srev2 = [] #Source Second Reverberation
Str = [] #Reverberation Time by Source
Vi = []

Vi.append(Geometry)
Vi.append(Listener)
Vi.append(Sources)

def pan(Li,So):#Li = Listener list input / So = Source point to test
    """Calculation for pano : distance from left point minus distance from right point"""
    Tl = ((Li[0])[1])
    Tr = ((Li[0])[2])
    pano =(((rs.Distance(Tl,So))-(rs.Distance(Tr,So))+Lh)*(127/(2*Lh)))
    return pano;
def DecDist(Ht,Dis):#Ht = listener height reference (scale)/Distance from listener point to source 
    Ds = (Dis*1.8)/(Ht)
    dec = (10*math.log10(Ds))
    filter = (1/Ds)*15000
    return [-(dec),filter];
def inter_S_B(s,div,Lis,br): #s =Source object (as a list), div = number of division (in u/v), Lis = Listener Object (as a list), br = Breps (as a list)
    """Calculate intersection btwn signal (lines from sources) and geometry"""
    udiv = div
    vdiv = div
    srf = rs.AddSphere((s[1]),((s[2])*2.5))
    u = rs.SurfaceDomain(srf,0)
    v = rs.SurfaceDomain(srf,1)
    pts = []
    for i in range(0, udiv+1, 1):
        for j in range(0, vdiv+1, 1):
            pt = (i/udiv,j/vdiv,0)
            srfP = rs.SurfaceParameter(srf,pt)
            newpt = rs.EvaluateSurface(srf,srfP[0],srfP[1])
            pts.append(rs.AddPoint(newpt))
    lig = []
    lid = []
    for p in pts :
        lig.append(rs.AddLine((Lis[0])[1],p))
        lid.append(rs.AddLine((Lis[0])[2],p))
    ig = []
    id = []
    for i in lig :
        for u in br :
            if type(rs.CurveBrepIntersect(i,(u[0]))) == tuple :
                ig.append((rs.CurveBrepIntersect(i,(u[0])))+(u[1],))
            else :
                ig.append((rs.CurveBrepIntersect(i,(u[0]))))
    for i in lid :
        for u in br:
            if type(rs.CurveBrepIntersect(i,(u[0]))) == tuple :
                id.append((rs.CurveBrepIntersect(i,(u[0])))+(u[1],))
            else :
                id.append((rs.CurveBrepIntersect(i,(u[0]))))
    if len(id) == 0:
        raise Exception(' You must connect a geometry !')
    intg=0
    for i in ig:
        if type(i) is tuple :
            intg += (1*(i[-1]))
    intd=0
    for i in id:
        if type(i) is tuple :
            intd += (1*(i[-1]))
    difg = len(ig)-intg
    if difg <= 0 :
        difg = 0.1
    difd = len(id)-intd
    if difd <=0 :
        difd =0.1
    return [(((math.log10(difg*100/len(ig)))*35.3)-70.6),(((math.log10(difd*100/len(id)))*35.3)-70.6)];

def rev(Ge,Lis,Src,div,Oalpha): # Calculate First and second reverberation from Geometry, Listener, Source and number of ray by source (div), 0alpha is the general alpha sabine coeff
    udiv = div
    vdiv = div
    Pt_L = Lis [0][0]
#    Pt_R = Lis [0][2]
    srf = []
    FirstRay = []
    SecondRay = []
    First_RefPoint = []
    drawray =[]
    Reverb = []
    for i in Ge :
        srf.append(i[0])
    sph =(rs.AddSphere(Src[1],Src[2]))
    Src_pt =(Src[1])
    u = rs.SurfaceDomain(sph,0)
    v = rs.SurfaceDomain(sph,1)
    pts = []
    for i in range(0, udiv+1, 1):
        for j in range(0, vdiv+1, 1):
            pt = (i/udiv,j/vdiv,0)
            sphP = rs.SurfaceParameter(sph,pt)
            newpt = rs.EvaluateSurface(sph,sphP[0],sphP[1])
            pts.append(rs.AddPoint(newpt))
    Dir = []
    for p in pts:
        Dir.append(rs.VectorCreate(p,Src_pt))
    Reflexion = []
    for d in Dir :
        Reflexion.append(rs.ShootRay(srf,Src_pt,d,reflections=10)) #Project Ray on Brep to calculate 1st and 2nd reflexions
    Project = []#First refkexion Point
    for v in Reflexion :
        Cl_Pt = []
        Ray_v = []
        try :
            Project.append(v[1]) # Add First Reflexion point to reference and for visulaization
            Ray_v.append(rs.AddPolyline(v))
        except :
            pass
        for u in Ray_v :
            pt_on = rs.CurveClosestPoint (u,Pt_L)
            cl = rs.EvaluateCurve(u,pt_on)
            Dicl = (rs.Distance(Pt_L,cl))
            if Dicl <= ((Lis [0])[3]):
                try :
                    First_RefPoint = rs.CurveClosestPoint (u,v[1])
                    Second_RefPoint = rs.CurveClosestPoint (u,v[2])
                    endc=((rs.CurveClosestPoint(u,(rs.CurveEndPoint(u)))))
                    if pt_on > Second_RefPoint :
                        SecondRay.append(pt_on/endc*(rs.CurveLength(u)))
                        drawray.append(u)
                    elif pt_on > First_RefPoint :
                        FirstRay.append(pt_on/endc*(rs.CurveLength(u)))
                except :
                    pass
    box = rs.AddBox(rs.BoundingBox(Project))
    boxarea = round((rs.SurfaceArea(box)[0]),2)
    surfacetorev = []
    for s in srf :
        ptons = []
        for p in Project :
            if rs.Distance((rs.BrepClosestPoint(s,p)[0]),p) < 0.1 :
                ptons.append(p)
        if len(ptons) > 0 :
            surfacetorev.append(s)
    bbox = box
    box = round(((rs.SurfaceVolume(box))[0]),1)
    srfvol = []
    srfarea =[]
    for i in surfacetorev :
        if rs.SurfaceVolume(i) > 0 :
            srfvol.append(i)
        else :
            srfarea.append(rs.SurfaceArea(i)[0])
    srfvol = rs.ExplodePolysurfaces(srfvol)
#    srfonbrep = [] #Reverbering Surfaces
    for i in srfvol :
        ptonsrf = []
        for p in Project :
            if rs.Distance((rs.BrepClosestPoint(i,p)[0]),p) < 0.01 :
                ptonsrf.append(p)
        if len(ptonsrf) > 0 :
            srfarea.append(rs.SurfaceArea(i)[0])
#            srfonbrep.append(i) #Reverbering Surfaces
    BuiltArea = 0
    for i in srfarea :
        BuiltArea += i
    BuiltArea = round(BuiltArea,2)
    EmptyArea = round(boxarea - BuiltArea,2)
    if EmptyArea < 0 :
        EmptyArea = 0
    TR = -((0.16*box)/((BuiltArea*(math.log(1-Oalpha)))+(EmptyArea*(math.log(0.1))))) #Eyring TR
#    TR = ((0.16*box)/((BuiltArea*Oalpha)+(EmptyArea))) #Sabine TR
    TR = round((TR*100)/2.5)
    
    

    FRValue = 0
    for f in FirstRay :
        FV = ((((Lis [0])[3])*15)/f)
        FRValue += FV
    if FRValue >=125 :
        FRValue = 125
    SRValue = 0
    for s in SecondRay :
        SV = ((((Lis [0])[3])*20)/s)
        SRValue += SV
    if SRValue > 125 :
        SRValue = 125
    Reverb.append(round(FRValue))
    Reverb.append(round(SRValue))
    Reverb.append(TR)
    return Reverb

a =[]
for iS in range(len(Sources)):
    Closest_pt_on_sphere = (rs.BrepClosestPoint ((rs.AddSphere((Sources[iS])[1],(Sources[iS])[2])), Lp))
    Si.append("S_{}".format(iS+1))
    Distance = (rs.Distance(Lp,(Closest_pt_on_sphere[0])))
    SDi.append(DecDist(Lh,Distance))
    spthi = (Sources[iS][0][0]).replace('\\','/')
    PathList = (spthi).split()
    PercentS = ("\ ").join(PathList)
    if Reset == True :
        SPa.append(0)
    else :
        SPa.append(PercentS) # Convert rhinopython path to maxmsp path (space are "\ " and "\" are "/"
    SPan.append(pan(Listener,(Sources[iS])[1]))
    Sint.append(inter_S_B((Sources[iS]),3,Listener,Geometry))
    if Reverb_on == True :
        Srev = (rev(Geometry,Listener,(Sources[iS]),50,alpha))
        Srev1.append((Srev)[0])
        Srev2.append((Srev)[1])
        Str.append((Srev)[2])
#        a.append((Srev)[2])#data to visualize (output)
#a = a[0]

io = int((len(Sources)-1))
i_msg = []
iosc = []

for i in range(9):#Maximum number of sources
    try:
        pathold = oldpath[i]
    except IndexError :
        oldpath.insert(i,["empty"])
    except NameError :
        oldpath = []
        oldpath.append(["empty"])
    iport = (57100+i)
    iosc.append(OSC.OSCClient())
    iosc[i].connect(("127.0.0.1",iport))
    i_msg.append(OSC.OSCMessage())
    if i <= io :# play sources pluged in
        i_msg[i].append(SDi[i][0])
        i_msg[i].append(SDi[i][1])
        i_msg[i].append(SPa[i])
        i_msg[i].append(SPan[i])
        if ((i_msg[i])[2]) != (oldpath[i]) :
            i_msg[i].append(1)
        else :
            i_msg[i].append(2)
        i_msg[i].append(Sint[i])
        try :
            i_msg[i].append(Srev1[i])
            i_msg[i].append(Srev2[i])
            i_msg[i].append(Str[i])
        except :
            i_msg[i].append(0)
            i_msg[i].append(0)
            i_msg[i].append(0)
        iosc[i].send(i_msg[i])
        oldpath[i] = SPa[i]
    else :
        i_msg[i].append(-127)
        i_msg[i].append(0)
        i_msg[i].append(0)
        i_msg[i].append(0)
        i_msg[i].append(0)
        i_msg[i].append(0)
        i_msg[i].append(0)
        i_msg[i].append(0)
        i_msg[i].append(0)
        i_msg[i].append(0)

    print "message, source {} : {}".format(i,i_msg[i])
    iosc[i].send(i_msg[i])
# ---------- end esquis_sons ----------

# ----
# Beta 2.0 _ MARS 2018
# 6// VISUALIZATION :
# 
# Simply connect the vi output from the main engine
# It allows you to visualize reflexions as rays
_1st_rays = FirstReflections(Vi=esquis_sons)  # -> Ray1; inputs Vi: list
# ---------- _1st_rays: Python ----------
#Esquis'sons! Launcher is a part of Esquis'sons!
#Esquissons license : CeCILL 2.1
#Creator : Théo Marchal (theo.marchal@grenoble.archi.fr)
#
#Disclaimer : This is only a summary and not a substitute to the full License :
#The Licensee is authorized to use the Software, without any limitation as to its fields of application, with it being hereinafter specified that this comprises:
#
#	1	permanent or temporary reproduction of all or part of the Software by any or all means and in any or all form. 
#	2	loading, displaying, running, or storing the Software on any or all medium.
#	3	entitlement to observe, study or test its operation so as to determine the ideas and principles behind any or all constituent elements of said Software. This shall apply when the Licensee carries out any or all loading, displaying, running, transmission or storage operation as regards the Software, that it is entitled to carry out hereunder.
#		
#The Holder owns the economic rights over the Initial Software. Any or all use of the Initial Software is subject to compliance with the terms and conditions under which the Holder has elected to distribute its work and no one shall be entitled to modify the terms and conditions for the distribution of said Initial Software.
#
#The Licensee expressly undertakes:
#	1	not to remove, or modify, in any manner, the intellectual property notices attached to the Software;
#	2	to reproduce said notices, in an identical manner, in the copies of the Software modified or not. 
#The Licensee undertakes not to directly or indirectly infringe the intellectual property rights on the Software of the Holder and/or Contributors, and to take, where applicable, vis-à-vis its staff, any and all measures required to ensure respect of said intellectual property rights of the Holder and/or Contributors.


"""First Reflections : Visualize 1st Reflexion close to listener.
Use Visualize Output of "Esquis'Sons! Main engine" :)
-
AAU / Théo Marchal / BETA VERSION / MARS 2018"""

ghenv.Component.Params.Input[0].Description = "Visualize (from esquissons main engine)"
ghenv.Component.Params.Output[0].Description = "First Reflexion Rays"
ghenv.Component.Name = "First Reflections"
ghenv.Component.NickName = "1st Rays" 
ghenv.Component.Message = "Esquis'sons! BETA V2"
ghenv.Component.Category = "Esquis'Sons!"
ghenv.Component.SubCategory = "2/ Visualization"

import rhinoscriptsyntax as rs

try:
    Ge =Vi[0]
except:
    raise Exception(' A "Vi" ouptut from main engine must be connected !')
Lis =Vi[1]
Src =Vi[2]
udiv = 50
vdiv = 50
Pt_L = Lis [0][0]
Pt_R = Lis [0][2]
srf = []
FirstRay = []
SecondRay = []
First_RefPoint = []
drawray =[]
for i in Ge :
    srf.append(i[0])
for i in Src :
    sph =(rs.AddSphere(i[1],i[2]))
    Src_pt =(i[1])
    u = rs.SurfaceDomain(sph,0)
    v = rs.SurfaceDomain(sph,1)
    pts = []
    for i in range(0, udiv+1, 1):
        for j in range(0, vdiv+1, 1):
            pt = (i/udiv,j/vdiv,0)
            sphP = rs.SurfaceParameter(sph,pt)
            newpt = rs.EvaluateSurface(sph,sphP[0],sphP[1])
            pts.append(rs.AddPoint(newpt))
    Dir = []
    for p in pts:
        Dir.append(rs.VectorCreate(p,Src_pt))
    Reflexion = []
    for d in Dir :
        Reflexion.append(rs.ShootRay(srf,Src_pt,d,reflections=10))
    SourceRay = []
    for v in Reflexion :
        Cl_Pt = []
        Ray_v = []
        try :
            Ray_v.append(rs.AddPolyline(v))
        except :
            pass
        for u in Ray_v :
            pt_on = rs.CurveClosestPoint (u,Pt_L)
            cl = rs.EvaluateCurve(u,pt_on)
            Dicl = (rs.Distance(Pt_L,cl))
            if Dicl <= ((Lis [0])[3]):
                try :
                    First_RefPoint = rs.CurveClosestPoint (u,v[1])
                    Second_RefPoint = rs.CurveClosestPoint (u,v[2])
                    endc=((rs.CurveClosestPoint(u,(rs.CurveEndPoint(u)))))
                    if pt_on > Second_RefPoint :
                        SecondRay.append(pt_on/endc*(rs.CurveLength(u)))
                    elif pt_on > First_RefPoint :
                        FirstRay.append(pt_on/endc*(rs.CurveLength(u)))
                        drawray.append(u)
                except :
                    pass
if len(drawray) == 0 :
    Ray1 ='No ray, please be sure Geometries are connected to main engine and placed to create reflexions'
else : 
    Ray1 = drawray
print FirstRay
print SecondRay
# ---------- end _1st_rays ----------
_2nd_rays = SecondReflections(Vi=esquis_sons)  # -> Ray2; inputs Vi: list
# ---------- _2nd_rays: Python ----------
#Esquis'sons! Launcher is a part of Esquis'sons!
#Esquissons license : CeCILL 2.1
#Creator : Théo Marchal (theo.marchal@grenoble.archi.fr)
#
#Disclaimer : This is only a summary and not a substitute to the full License :
#The Licensee is authorized to use the Software, without any limitation as to its fields of application, with it being hereinafter specified that this comprises:
#
#	1	permanent or temporary reproduction of all or part of the Software by any or all means and in any or all form. 
#	2	loading, displaying, running, or storing the Software on any or all medium.
#	3	entitlement to observe, study or test its operation so as to determine the ideas and principles behind any or all constituent elements of said Software. This shall apply when the Licensee carries out any or all loading, displaying, running, transmission or storage operation as regards the Software, that it is entitled to carry out hereunder.
#		
#The Holder owns the economic rights over the Initial Software. Any or all use of the Initial Software is subject to compliance with the terms and conditions under which the Holder has elected to distribute its work and no one shall be entitled to modify the terms and conditions for the distribution of said Initial Software.
#
#The Licensee expressly undertakes:
#	1	not to remove, or modify, in any manner, the intellectual property notices attached to the Software;
#	2	to reproduce said notices, in an identical manner, in the copies of the Software modified or not. 
#The Licensee undertakes not to directly or indirectly infringe the intellectual property rights on the Software of the Holder and/or Contributors, and to take, where applicable, vis-à-vis its staff, any and all measures required to ensure respect of said intellectual property rights of the Holder and/or Contributors.


"""Second Reflections : Visualize 2nd Reflexion close to listener.
Use Visualize Output of "Esquis'Sons! Main engine" :)
-
AAU / Théo Marchal / BETA VERSION / MARS 2018"""

ghenv.Component.Params.Input[0].Description = "Visualize (from esquissons main engine)"
ghenv.Component.Params.Output[0].Description = "Second Reflexion Rays"
ghenv.Component.Name = "Second Reflections"
ghenv.Component.NickName = "2nd Rays" 
ghenv.Component.Message = "Esquis'sons! BETA V2"
ghenv.Component.Category = "Esquis'Sons!"
ghenv.Component.SubCategory = "2/ Visualisation"

import rhinoscriptsyntax as rs
try:
    Ge =Vi[0]
except:
    raise Exception(' A "Vi" ouptut from main engine must be connected !')
Lis =Vi[1]
Src =Vi[2]
udiv = 50
vdiv = 50
Pt_L = Lis [0][0]
Pt_R = Lis [0][2]
srf = []
FirstRay = []
SecondRay = []
First_RefPoint = []
drawray =[]
for i in Ge :
    srf.append(i[0])
for i in Src :
    sph =(rs.AddSphere(i[1],i[2]))
    Src_pt =(i[1])
    u = rs.SurfaceDomain(sph,0)
    v = rs.SurfaceDomain(sph,1)
    pts = []
    for i in range(0, udiv+1, 1):
        for j in range(0, vdiv+1, 1):
            pt = (i/udiv,j/vdiv,0)
            sphP = rs.SurfaceParameter(sph,pt)
            newpt = rs.EvaluateSurface(sph,sphP[0],sphP[1])
            pts.append(rs.AddPoint(newpt))
    Dir = []
    for p in pts:
        Dir.append(rs.VectorCreate(p,Src_pt))
    Reflexion = []
    for d in Dir :
        Reflexion.append(rs.ShootRay(srf,Src_pt,d,reflections=10))
    SourceRay = []
    for v in Reflexion :
        Cl_Pt = []
        Ray_v = []
        try :
            Ray_v.append(rs.AddPolyline(v))
        except :
            pass
        for u in Ray_v :
            pt_on = rs.CurveClosestPoint (u,Pt_L)
            cl = rs.EvaluateCurve(u,pt_on)
            Dicl = (rs.Distance(Pt_L,cl))
            if Dicl <= ((Lis [0])[3]):
                try :
                    First_RefPoint = rs.CurveClosestPoint (u,v[1])
                    Second_RefPoint = rs.CurveClosestPoint (u,v[2])
                except :
                    pass
                endc=((rs.CurveClosestPoint(u,(rs.CurveEndPoint(u)))))
                if pt_on > Second_RefPoint :
                    SecondRay.append(pt_on/endc*(rs.CurveLength(u)))
                    drawray.append(u)
                elif pt_on > First_RefPoint :
                    FirstRay.append(pt_on/endc*(rs.CurveLength(u)))
if len(drawray) == 0 :
    Ray2 ='No ray, please be sure Geometries are connected to main engine and placed to create reflexions'
else : 
    Ray2 = drawray
print FirstRay
print SecondRay
#b = First_RefPoint
#
#Reflexion = rs.ShootRay(surface_ids, start_point, direction, reflections=10)
# ---------- end _2nd_rays ----------
